% Simulink data dictionary neck_mk3.sldd

Vcc = 48

ControlCommands = Simulink.Bus()
  Voltage: single[3], Min=-100, Max=100, Unit="%"  % Actuation voltage signals.

Measurements = Simulink.Bus()
  Encoders: single[3], Unit="deg"

References = Simulink.Bus()
  SetPoints: single[3], Unit="deg"  % Setpoints that the system needs to track.

ControlFeedback = Simulink.Bus()
  Encoders: single[3], Unit="deg"

Physical_Velocity = Simulink.ConnectionBus()
  Element: Connection: <domain name>

Physical_Effort = Simulink.ConnectionBus()
  Element: Connection: <domain name>

Physical_JointsFeedback = Simulink.ConnectionBus()
  Element: Connection: <domain name>

Physical_MechanicalLinks = Simulink.ConnectionBus()
  Element: Connection: simmechanics.connections.geometry

Physical_MotorPhases = Simulink.ConnectionBus()
  Element: Connection: foundation.electrical.electrical

Physical_MotorsFeedback = Simulink.ConnectionBus()
  Currents: Connection: foundation.electrical.electrical
  Power: Connection: foundation.electrical.electrical

MCU_Ts = 0.001